# Grasshopper definition WaveFunctionCollapse.gh (Grasshopper 1.0.4)
# plug-ins: WaveFunctionCollapse

panel = Panel("TILE 01")
half_tile = Surface(graft([<surface referenced from the Rhino model> x5]))
box_corners = BoxCorners(Box=half_tile)  # -> CornerA, CornerB, CornerC, CornerD, CornerE, CornerF, CornerG, CornerH
average = Average(Input=[box_corners.CornerB, box_corners.CornerA, box_corners.CornerC, box_corners.CornerD])  # -> flatten(ArithmeticMean)

# ---- group: COLOURS
second_tile_colour = ColourSwatch(SwatchColor=RGB(69, 133, 125))
empty_tile_colour = ColourSwatch(SwatchColor=RGB(217, 217, 210))
first_tile_colour = ColourSwatch(SwatchColor=RGB(100, 176, 168))

# ----
c_script = CSharpScript(
    switcher=Toggle(True),
    canvas_back=ColourSwatch(SwatchColor=RGB(219, 219, 218)),
    canvas_grid=ColourSwatch(SwatchColor=RGB(192, 190, 191)))  # -> out, A; inputs switcher: Boolean, canvas_back: Color, canvas_grid: Color
# ---------- c_script: C# ----------
    if (switcher == true)
    {
      Grasshopper.GUI.Canvas.GH_Skin.canvas_grid = canvas_grid;
      Grasshopper.GUI.Canvas.GH_Skin.canvas_back = canvas_back; 
      Grasshopper.GUI.Canvas.GH_Skin.canvas_edge = Color.FromArgb(255, 0, 0, 0); 
      Grasshopper.GUI.Canvas.GH_Skin.canvas_shade = Color.FromArgb(80, 0, 0, 0); 
    }
    else
    {
      //DEFAULTS
      Grasshopper.GUI.Canvas.GH_Skin.canvas_grid = Color.FromArgb(30, 0, 0, 0);
      Grasshopper.GUI.Canvas.GH_Skin.canvas_back = Color.FromArgb(255, 212, 208, 200); 
      Grasshopper.GUI.Canvas.GH_Skin.canvas_edge = Color.FromArgb(255, 0, 0, 0); 
      Grasshopper.GUI.Canvas.GH_Skin.canvas_shade = Color.FromArgb(80, 0, 0, 0);
    }
# ---------- end c_script ----------

tiles_area = Surface(graft(<surface referenced from the Rhino model>))
panel_2 = Panel("Sample Tile Size")
dimensions = Dimensions(Surface=tiles_area)  # -> UDimension, VDimension
divide_surface = DivideSurface(Surface=tiles_area, UCount=dimensions.UDimension, VCount=dimensions.VDimension)  # -> flatten(Points), Normals, Parameters
c_script_2 = CSharpScript(PointsX=divide_surface.Points)  # -> out, flatten(A), B; inputs PointsX: list of Point3d
# ---------- c_script_2: C# ----------
    var res = new List<Point3d>();

    for (int i = 0; i < PointsX.Count; i++)
    {

      if (Convert.ToInt32(PointsX[i].X) % 2 != 0 && Convert.ToInt32(PointsX[i].Y) % 2 != 0)
      {
        res.Add(PointsX[i]);
      }

    }

    A = res;

    B = PointsX.Count;
# ---------- end c_script_2 ----------

panel_3 = Panel("TILE 02")
full_tile = Surface(graft([<surface referenced from the Rhino model> x7]))
box_corners_2 = BoxCorners(Box=full_tile)  # -> CornerA, CornerB, CornerC, CornerD, CornerE, CornerF, CornerG, CornerH
average_2 = Average(Input=[box_corners_2.CornerC, box_corners_2.CornerA, box_corners_2.CornerB, box_corners_2.CornerD])  # -> flatten(ArithmeticMean)

file_path = FilePath("R:\sample_image\05.png")
import_image = ImportImage(File=file_path)
custom_preview = CustomPreview(Geometry=tiles_area, Material=empty_tile_colour)
bounding_box = BoundingBox(Content=import_image, Plane=PlaneXY(0, 0, 0))  # -> Box, Box_2
mesh = Mesh(import_image)
number_slider = Slider(1, range=0..1)
custom_preview_2 = CustomPreview(Geometry=half_tile, Material=first_tile_colour)

# ---- group: WAVE
tiles_area_2 = Surface(<surface referenced from the Rhino model>)
dimensions_2 = Dimensions(Surface=tiles_area_2)  # -> UDimension, VDimension
divide_surface_2 = DivideSurface(Surface=tiles_area_2, UCount=dimensions_2.UDimension, VCount=dimensions_2.VDimension)  # -> flatten(Points), Normals, Parameters
c_script_3 = CSharpScript(PointsX=divide_surface_2.Points)  # -> out, flatten(A), B; inputs PointsX: list of Point3d
# ---------- c_script_3: C# ----------
    var res = new List<Point3d>();

    for (int i = 0; i < PointsX.Count; i++)
    {

      if (Convert.ToInt32(PointsX[i].X) % 2 == 0 && Convert.ToInt32(PointsX[i].Y) % 2 == 0)
      {
        res.Add(PointsX[i]);
      }

    }

    A = res;

    B = PointsX.Count;
# ---------- end c_script_3 ----------

# ----
deconstruct_brep = DeconstructBrep(Brep=bounding_box.Box)  # -> Faces, Edges, Vertices
custom_preview_3 = CustomPreview(Geometry=full_tile, Material=second_tile_colour)
dimensions_3 = Dimensions(Surface=deconstruct_brep.Faces)  # -> UDimension, VDimension
scale = Scale(Geometry=half_tile, Center=average, Factor=number_slider)  # -> Geometry, Transform
scale_2 = Scale(Geometry=full_tile, Center=average_2, Factor=number_slider)  # -> Geometry, Transform
division = Division(A=dimensions_3.UDimension, B=dimensions_3.VDimension)
c_script_4 = CSharpScript(x=average, y=average_2, z=c_script_2.A)  # -> out, A; inputs x: list of Point3d, y: list of Point3d, z: list of Point3d
# ---------- c_script_4: C# ----------
    int[] weights = new int[3];

    weights[0] = x.Count;
    weights[1] = y.Count;
    weights[2] = z.Count - x.Count - y.Count;

    A = weights;
# ---------- end c_script_4 ----------
multiplication = Multiplication(A=division, B=Slider(1, range=0..100))
patterns_testtt = Patterns_testtt(
    TileTypeA=average,
    TileTypeB=average_2,
    WholeTilePoints=c_script_2.A,
    TileSize=Slider(2, range=0..10),
    RotateTiles=Toggle(True))  # -> PatternFromSampleParameter, HalfTiles, FullTiles, EmptyTiles
integer = Integer(multiplication)
panel_4 = Panel("5")
one_over_x = OneOverX(Value=integer)
one_over_x_2 = OneOverX(Value=integer)
boolean_toggle = BooleanToggle(True)
panel_5 = Panel([one_over_x, one_over_x_2])
getwavedimension = GetWaveDimension(Wave=c_script_3.A)  # -> Width, Height
rectangular = Rectangular(
    Plane=PlaneXY(0, 0, 0),
    SizeX=one_over_x,
    SizeY=one_over_x_2,
    ExtentX=getwavedimension.Width,
    ExtentY=getwavedimension.Height)  # -> Cells, Points
number_slider_2 = Slider(8, range=0..30)
number_slider_3 = Slider(47, range=0..100)
observe_and_collapse = ObserveAndCollapse(
    PatternFromSampleParameter=patterns_testtt.PatternFromSampleParameter,
    Wave=c_script_3.A,
    Backtrack=boolean_toggle,
    Iterations="100")  # -> NumberOfRotatedTiles, PatternHistoryParameter, PatternCount, AverageContradictionValue
deconstruct = Deconstruct(Point=rectangular.Points)  # -> XComponent, YComponent, ZComponent
wfcx = WFCx(
    PatternFromSampleParameter=patterns_testtt.PatternFromSampleParameter,
    Wave=c_script_3.A,
    DatasetSize="600",
    Backtrack=boolean_toggle,
    Iterations="50")  # disabled
surface = Surface(<surface referenced from the Rhino model>)

# ---- group: PATTERN FROM SAMPLE: HALF TILE
c_script_5 = CSharpScript(Surface=surface, Vector=patterns_testtt.HalfTiles)  # -> out, A; inputs Surface: Surface, Vector: Vector3d
# ---------- c_script_5: C# ----------
    var copy = Surface.Duplicate();
    copy.Translate(Vector);

    A = copy;
# ---------- end c_script_5 ----------
custom_preview_4 = CustomPreview(Geometry=c_script_5.A, Material=first_tile_colour)

# ---- group: PATTERN FROM SAMPLE: FULL TILE
c_script_6 = CSharpScript(Surface=surface, Vector=patterns_testtt.FullTiles)  # -> out, A; inputs Surface: Surface, Vector: Vector3d; same code as c_script_5
custom_preview_5 = CustomPreview(Geometry=c_script_6.A, Material=second_tile_colour)

# ---- group: PATTERN FROM SAMPLE: NULL TILES
c_script_7 = CSharpScript(Surface=surface, Vector=patterns_testtt.EmptyTiles)  # -> out, A; inputs Surface: Surface, Vector: Vector3d; same code as c_script_5
custom_preview_6 = CustomPreview(Geometry=c_script_7.A, Material=empty_tile_colour)

# ----
getcontradictionsdata = GetContradictionsData(PatternFromSampleParameter=patterns_testtt.PatternFromSampleParameter, DatasetSize="1000", Backtrack=Toggle(False))  # -> SuccessfulRuns, SurfaceSize; disabled
unit_vector = UnitVector(Vector=rectangular.Points)
wave = Panel(c_script_3.A)
division_2 = Division(A=deconstruct.XComponent, B=getwavedimension.Width)
division_3 = Division(A=deconstruct.YComponent, B=getwavedimension.Height)

# ---- group: RANDOM SURFACE
randompattern = RandomPattern(
    Wave=c_script_3.A,
    TILE01=surface,
    TILE02=surface,
    EMPTY=surface,
    XWAVELOCATION=Slider(-40, range=-110..50),
    YWAVELOCATION=Slider(41, range=-50..80),
    Weights=c_script_4.A)  # -> WaveHalfSurfaces, WaveFullSurfaces, WaveEmptySurfaces
custom_preview_7 = CustomPreview(Geometry=randompattern.WaveEmptySurfaces, Material=empty_tile_colour)
custom_preview_8 = CustomPreview(Geometry=randompattern.WaveFullSurfaces, Material=second_tile_colour)
custom_preview_9 = CustomPreview(Geometry=randompattern.WaveHalfSurfaces, Material=first_tile_colour)

# ----
boolean_toggle_2 = BooleanToggle(True)
iterations = Panel("80")
data_size = Panel("100")
text = Text("d")
text_2 = Text("m")
construct_point = ConstructPoint(XCoordinate=division_2, YCoordinate=division_3, ZCoordinate=0)
image_sampler = ImageSampler(
    flatten(construct_point),
    FilePath="R:\sample_image\05.png",
    Filter="Value",
    Interpolate=True,
    Umax=22,
    Umin=1,
    Vmax=23,
    Vmin=1,
    Wrap=2)
panel_6 = Panel(observe_and_collapse.PatternHistoryParameter)
visualise_by_history = VisualiseByHistory(
    WaveFunctionCollapsed=observe_and_collapse.PatternHistoryParameter,
    Timelapse=Slider(1, range=0..1),
    TILE01=surface,
    TILE02=surface,
    TILE03=surface,
    XWAVELOCATION=number_slider_2,
    YWAVELOCATION=number_slider_3,
    Tile01Colour=first_tile_colour,
    Tile02Colour=second_tile_colour,
    TileEmpty=empty_tile_colour)  # -> WaveHalfSurfaces, WaveFullSurfaces, WaveEmptySurfaces, Colours, Uncollapsed, PatternCount, Entropies
panel_7 = Panel(getcontradictionsdata.SurfaceSize)
panel_8 = Panel(getcontradictionsdata.SuccessfulRuns)
unit_z = UnitZ(Factor=Slider(8, range=0..10))
export_wfc = ExportWfc(WaveFunctionDataset=wfcx, PatternFromSample=patterns_testtt.PatternFromSampleParameter, SeriesName=text)  # disabled
panel_9 = Panel(wfcx)
exportwfcforpix2pix = ExportWFCforPix2Pix(WaveFunctionDataset=wfcx, PatternFromSample=patterns_testtt.PatternFromSampleParameter, SeriesName=text_2)
unit_z_2 = UnitZ(Factor=Slider(4, range=0..10))
wfcbyimage = WFCbyImage(
    PatternFromSampleParameter=patterns_testtt.PatternFromSampleParameter,
    Wave=c_script_3.A,
    Backtrack=boolean_toggle_2,
    Iterations="50",
    Image=image_sampler)
panel_10 = Panel(image_sampler)
wfcbyimage_multiple = WFCByImage_Multiple(
    PatternFromSampleParameter=patterns_testtt.PatternFromSampleParameter,
    Wave=c_script_3.A,
    Backtrack=boolean_toggle_2,
    Iterations=iterations,
    DatasetSize=data_size,
    Image=image_sampler)  # disabled
panel_11 = Panel(construct_point)
scale_3 = Scale(Center=Point(0, 0, 0), Factor=0.5)  # -> Geometry, Transform
extrude = Extrude(Base=scale.Geometry, Direction=unit_z_2)
extrude_2 = Extrude(Base=scale_2.Geometry, Direction=unit_z)
evaluateimageresult_multiple = EvaluateImageResult_Multiple(PatternHistoryParameter=wfcx)  # -> DarkCellSuccessRate, SuccessList; disabled
custom_preview_10 = CustomPreview(Geometry=visualise_by_history.Uncollapsed, Material=visualise_by_history.Colours)
custom_preview_11 = CustomPreview(Geometry=visualise_by_history.WaveFullSurfaces, Material=second_tile_colour)
evaluateimageresult = EvaluateImageResult(WaveFunctionCollapsed=[wfcbyimage, observe_and_collapse.PatternHistoryParameter])
visualise_by_history_2 = VisualiseByHistory(
    WaveFunctionCollapsed=wfcbyimage,
    Timelapse=Slider(1, range=0..1),
    TILE01=surface,
    TILE02=surface,
    TILE03=surface,
    XWAVELOCATION=Slider(89, range=0..100),
    YWAVELOCATION=number_slider_3,
    Tile01Colour=first_tile_colour,
    Tile02Colour=second_tile_colour,
    TileEmpty=empty_tile_colour)  # -> WaveHalfSurfaces, WaveFullSurfaces, WaveEmptySurfaces, Colours, Uncollapsed, PatternCount, Entropies
custom_preview_12 = CustomPreview(Geometry=visualise_by_history.WaveFullSurfaces, Material=second_tile_colour)
custom_preview_13 = CustomPreview(Geometry=visualise_by_history.WaveHalfSurfaces, Material=first_tile_colour)
panel_12 = Panel(wfcbyimage_multiple)
custom_preview_14 = CustomPreview(Geometry=extrude_2, Material=ColourSwatch(SwatchColor=RGB(114, 133, 125)))
evaluateimageresult_multiple_2 = EvaluateImageResult_Multiple(PatternHistoryParameter=wfcbyimage_multiple)  # -> DarkCellSuccessRate, SuccessList
custom_preview_15 = CustomPreview(Geometry=extrude, Material=ColourSwatch(SwatchColor=RGB(107, 158, 176)))
panel_13 = Panel([evaluateimageresult_multiple.DarkCellSuccessRate, evaluateimageresult_multiple.SuccessList])
addition = Addition(A=number_slider_2, B=Slider(65, range=0..100))
custom_preview_16 = CustomPreview(Geometry=visualise_by_history_2.Uncollapsed, Material=visualise_by_history_2.Colours)
savesuccessratetocsv = SaveSuccessRateToCSV(
    DarkCellSuccessRate=evaluateimageresult_multiple_2.DarkCellSuccessRate,
    SuccessList=evaluateimageresult_multiple_2.SuccessList,
    MethodName="Linear mapping_without_domain")
panel_14 = Panel(evaluateimageresult)
evaluateproportions = EvaluateProportions(
    WaveHalfSurfaces=visualise_by_history.WaveHalfSurfaces,
    WaveFullSurfaces=visualise_by_history.WaveFullSurfaces,
    WaveEmptySurfaces=visualise_by_history.WaveEmptySurfaces,
    X=addition,
    Y=number_slider_3)  # -> port, port_2, port_3, port_4, port_5, port_6
panel_15 = Panel([evaluateimageresult_multiple_2.DarkCellSuccessRate, evaluateimageresult_multiple_2.SuccessList])
savesuccessratetocsv_2 = SaveSuccessRateToCSV(
    DarkCellSuccessRate=evaluateimageresult_multiple.DarkCellSuccessRate,
    SuccessList=evaluateimageresult_multiple.SuccessList,
    MethodName="Normal")
partition_list = PartitionList(List=visualise_by_history_2.Entropies, Size="23")
panel_16 = Panel(partition_list)
custom_preview_17 = CustomPreview(Geometry=evaluateproportions.port, Material=first_tile_colour)
custom_preview_18 = CustomPreview(Geometry=evaluateproportions.port_2, Material=second_tile_colour)
custom_preview_19 = CustomPreview(Geometry=evaluateproportions.port_3, Material=empty_tile_colour)

# ---- group: VISUALISE LINE
list_length = ListLength(List=visualise_by_history.PatternCount)
addition_2 = Addition(A=visualise_by_history.PatternCount, B=Slider(14, range=0..80))
series = Series(Start=Slider(21, range=0..100), Step=Slider(12.03, range=0..20), Count=list_length)

# ----
division_4 = Division(A=addition_2, B=Slider(1, range=0..9))

# ---- group: VISUALISE LINE (continued)
construct_point_2 = ConstructPoint(XCoordinate=series, YCoordinate=division_4, ZCoordinate=0)
interpolate = Interpolate(Vertices=construct_point_2, Degree=Slider(1, range=0..10), Periodic=False, KnotStyle=1)  # -> Curve, Length, Domain

# ----
custom_preview_20 = CustomPreview(Geometry=interpolate.Curve, Material=ColourSwatch(SwatchColor=RGB(219, 0, 0)))  # disabled
